# Grasshopper definition Cantilever.gh (Grasshopper 1.0.8)
# plug-ins: Bifocals, FEMur

number_slider = Slider(4, range=0..10)
unit_z = UnitZ(Factor=Slider(125, range=0..1000000))
point = Point(Point(0, 0, 0))
linear_array = LinearArray(Geometry=point, Direction=unit_z, Count=number_slider)  # -> Geometry, Transform
polyline = PolyLine(Vertices=linear_array.Geometry, Closed=False)
number_slider_2 = Slider(200, range=0..1000)
node_femur = NodeFEMur(Points=linear_array.Geometry)
subtraction = Subtraction(A=number_slider, B="1")
crosssection_h_femur = CrossSectionHFEMur(
    Id=0,
    Name="H-Section",
    B=number_slider_2,
    H=number_slider_2,
    T_f=Slider(12, range=0..100),
    T_w=Slider(8, range=0..10),
    R=6)
material_femur = MaterialFEMur(Id=0)
split_list = SplitList(List=node_femur, Index=subtraction)  # -> ListA, ListB
split_list_2 = SplitList(List=node_femur, Index=Slider(1, range=0..1))  # -> ListA, ListB
unit_x = UnitX(Factor=Slider(10000, range=0..10000))
boolean_toggle = BooleanToggle(True)
panel = Panel(crosssection_h_femur)
beamelement_femur = BeamElementFEMur(INodes=split_list.ListA, JNodes=split_list_2.ListB, Material=material_femur, CrossSection=crosssection_h_femur)
pointload_femur = PointLoadFEMur(Nodes=split_list.ListB, Force=unit_x, Moment=Vector(0, 0, 0), IsLocal=False)
support_femur = SupportFEMur(
    Nodes=split_list_2.ListA,
    UX=boolean_toggle,
    UY=boolean_toggle,
    UZ=boolean_toggle,
    RX=boolean_toggle,
    RY=boolean_toggle,
    RZ=boolean_toggle)
panel_2 = Panel(beamelement_femur)
assemblemodel_femur = AssembleModelFEMur(Nodes=node_femur, Elements=beamelement_femur, Supports=support_femur, Loads=pointload_femur)
linearstaticsolver_femur = LinearStaticSolverFEMur(Model=assemblemodel_femur, Run=True)  # -> AnalyzedModel, Info, Warnings
resultview_femur = ResultViewFEMur(AnalyzedModel=linearstaticsolver_femur.AnalyzedModel, Scale=Slider(1000, range=0..1000))  # -> DeformedModel, DeformedNodes
deconstructresult_femur = DeconstructResultFEMur(AnalyzedModel=linearstaticsolver_femur.AnalyzedModel)  # -> NodalDisplacements, ElementStresses, DisplacementValues, StressInfo
panel_3 = Panel(deconstructresult_femur.ElementStresses)
sectionforceview_femur = SectionForceViewFEMur(AnalyzedModel=linearstaticsolver_femur.AnalyzedModel, Scale=Slider(0.0001, range=0..1))
